# Grasshopper definition Envoltória triangular 1.gh (Grasshopper 1.0.7)
# plug-ins: LunchBox

espessura_dos_triângulos = Slider(0.21, range=0..1)
tamanho_dos_triângulos = Slider(0.85, range=0..1)
divisões_da_superfície = Slider(4, range=1..100)
tamanho_do_disco = Slider(0.93, range=0..1)
surface = Surface(<surface referenced from the Rhino model>)
braced_grid_1_d_structure = BracedGrid1DStructure(Surface=surface, UDivisions=divisões_da_superfície, VDivisions=divisões_da_superfície)  # -> PrimaryLines, BraceLines, StructureNodes
triangular_panels_a = TriangularPanelsA(Surface=surface, UDivisions=divisões_da_superfície, VDivisions=divisões_da_superfície)
area = Area(Geometry=triangular_panels_a)  # -> Area, Centroid
curve_middle = CurveMiddle(Curve=braced_grid_1_d_structure.BraceLines)
curve_middle_2 = CurveMiddle(Curve=braced_grid_1_d_structure.PrimaryLines)
scale = Scale(Geometry=triangular_panels_a, Center=area.Centroid, Factor=tamanho_dos_triângulos)  # -> Geometry, Transform
circle_cnr = CircleCNR(Center=curve_middle_2, Normal=braced_grid_1_d_structure.PrimaryLines, Radius=tamanho_do_disco)
circle_cnr_2 = CircleCNR(Center=curve_middle, Normal=braced_grid_1_d_structure.BraceLines, Radius=tamanho_do_disco)
vector = Vector(scale.Geometry)
boundary_surfaces = BoundarySurfaces(Edges=circle_cnr)
boundary_surfaces_2 = BoundarySurfaces(Edges=circle_cnr_2)
multiplication = Multiplication(A=espessura_dos_triângulos, B=vector)
vector_2 = Vector(braced_grid_1_d_structure.PrimaryLines)
vector_3 = Vector(braced_grid_1_d_structure.BraceLines)
multiplication_2 = Multiplication(A=Slider(0.025, range=0..1), B=vector_2)
multiplication_3 = Multiplication(A=Slider(0.02, range=0..1), B=vector_3)
extrude = Extrude(Base=scale.Geometry, Direction=multiplication)
extrude_2 = Extrude(Base=boundary_surfaces_2, Direction=multiplication_3)
extrude_3 = Extrude(Base=boundary_surfaces, Direction=multiplication_2)
solid_difference = SolidDifference(BrepsA=extrude_2, BrepsB=extrude)
solid_difference_2 = SolidDifference(BrepsA=extrude_3, BrepsB=extrude)
